vi "SimUDuck.gvi"   [LabVIEW NXG 3.1.0]
panel indicators:
  "Error out": error
  "Duck out": "Duck.gtype"
  "String": string
uses:
  Duck.gtype::Fly.gvi
  Duck.gtype::Quack.gvi
  Duck.gtype::Display.gvi
  Duck.gtype::Swim.gvi
diagram:
  call "Fly.gvi"(Duck in="RubberDuck.gtype" constant) -> (Duck out=w1, Fly=w2, Error out=w3)
  call "Quack.gvi"(Duck in=w1, Error in=w3) -> (Duck out=w4, Quack=w5, Error out=w6)
  call "Display.gvi"(Duck in=w4, Error in=w6) -> (Duck out=w7, Display=w8, Error out=w9)
  call "Swim.gvi"(Duck in=w7, Error in=w9) -> (Duck out=w10, Swim=w11, Error out=w12)
  Format Into String(formatString="Duck Type: %s\nCan fly: %s\nCan swim: %s\nCan quack: %s", w8, w2, w11, w5) -> w13
  $String <- w13
  $"Duck out" <- w10
  $"Error out" <- w12
